# Grasshopper definition 14042023_main.gh (Grasshopper 1.0.7)
# plug-ins: FDMremote, Karamba3D, Kangaroo2 Components, MetaHopper

# ---- group: Adam's
# Box Ground Structure
nx = Slider(9, range=0..10)
ny = Slider(7, range=0..10)
nz = Slider(1, range=0..10)
lx = Slider(10, range=0..100)
ly = Slider(2, range=0..100)
lz = Slider(1, range=0..100)
expression = Expression(L=lx, x=nx, Expression="L/(x-1)")
python = GhPythonScript(L=ly, x=lz)  # -> out, a
# ---------- python: Python ----------
__author__ = "pitipatw"
__version__ = "2023.03.10"

import rhinoscriptsyntax as rs

if x==1 :
    a = 0
else:
    a = L/(x-1)
# ---------- end python ----------
python_2 = GhPythonScript(L=ly, x=ny)  # -> out, a; same code as python
box = CenterBox(Base=PlaneXY(0, 0, 0), X=expr("x/2", expression), Y=expr("x/2", python_2.a), Z=expr("x/2", python.a))
origin_point = ConstructPoint(XCoordinate=0, YCoordinate=0, ZCoordinate=0)
arrbox = BoxArray(Geometry=origin_point, Cell=box, XCount=nx, YCount=ny, ZCount=nz)  # -> Geometry, Transform
duppt = RemoveDuplicatePts(Points=arrbox.Geometry, Tolerance=0.01)
inter = InterconnectPoints(Pts=arrbox.Geometry)

# ----
brep = Brep(<brep referenced from the Rhino model>)
# Brep Ground Structure
nx_2 = Slider(17, range=0..20)
nz_2 = Slider(12, range=0..20)
ny_2 = Slider(3, range=0..20)
volume = Volume(Geometry=brep)  # -> Volume, Centroid
scale = Scale(Geometry=brep, Center=volume.Centroid, Factor=Slider(2, range=0..10))  # -> Geometry, Transform
bbox = BoundingBox(Content=scale.Geometry, Plane=PlaneXY(0, 0, 0))  # -> Box, Box_2
debox = DeconstructBox(Box=bbox.Box)  # -> Plane, X, Y, Z
dedomain = DeconstructDomain(Domain=debox.X)  # -> Start, End
dedomain_2 = DeconstructDomain(Domain=debox.Y)  # -> Start, End
dedomain_3 = DeconstructDomain(Domain=debox.Z)  # -> Start, End
subtraction = Subtraction(A=dedomain.End, B=dedomain.Start)
subtraction_2 = Subtraction(A=dedomain_2.End, B=dedomain_2.Start)
subtraction_3 = Subtraction(A=dedomain_3.End, B=dedomain_3.Start)
subtraction_4 = Subtraction(A=nx_2, B=1)
subtraction_5 = Subtraction(A=ny_2, B=1)
subtraction_6 = Subtraction(A=nz_2, B=1)
division = Division(A=subtraction, B=subtraction_4)
division_2 = Division(A=subtraction_2, B=subtraction_5)
division_3 = Division(A=subtraction_3, B=subtraction_6)
series = Series(Start=dedomain_2.Start, Step=division_2, Count=ny_2)
series_2 = Series(Start=dedomain.Start, Step=division, Count=nx_2)
series_3 = Series(Start=dedomain_3.Start, Step=division_3, Count=nz_2)
python_3 = GhPythonScript(x=series_2, y=series, z=series_3)  # -> out, a, pts; inputs x: list, y: list, z: list
# ---------- python_3: Python ----------
__author__ = "pitipatw"
__version__ = "2023.04.13"

import rhinoscriptsyntax as rs


nx = len(x)
ny = len(y)
nz = len(z)

np = nx*ny*nz
points = [[[0] * nx] * ny ] * nz
pts = []
for i in range(nx):
    for j in range(ny):
        for k in range(nz):
            #print(x[i],y[j],z[k])
            #pts = rs.AddPoint(x[i], y[j], z[k])
            pts.append(rs.CreatePoint(x[i], y[j], z[k]))
# ---------- end python_3 ----------
pt = Point(python_3.pts)
brepinc = PointInBrep(Brep=scale.Geometry, Point=pt, Strict=False)
cull = CullPattern(List=pt, CullPattern=brepinc)
inter_2 = InterconnectPoints(Pts=cull)

# ---- group: TopOpt Control
bake_points = Button()
gs_visibility = BooleanToggle(True)
interconnectivity = BooleanToggle(True)
max_members_length = Slider(1.1, range=0..20)
max_volume_fraction = Slider(0.1, range=0..1)
apply_length_limit = BooleanToggle(True)
groundstruct = Button()
optimization = Button()
list = ValueList({"2D": 2, "3D": 3}, selected="3D")

# ---- group: Components control
# This is a Topology Optimization using TopOpt.jl
# 
# last major modified: 14 April 2023
bake = BakeObject(Bake=bake_points, AllObjects_Object=pt_2)
onoff = EnableDisableObject(Enabled=apply_length_limit, AllObjects_Object=[smaller, cull_2, len])
# Notes:
# 
# For 2D problems, 3D model will be made,
# but z-axis constraints will be added to every node.
# 
# Actual separation is not implemented yet.
hideshow = HideShowObjectPreview(Visible=gs_visibility, AllObjects_Object=line)
# 5 4 6
# 0.27
# 3
# 0.27
# pass
# 5 4 6
# 0.27
# "2"
# 0.27
# fail
onoff_2 = EnableDisableObject(Enabled=interconnectivity, AllObjects_Object=inter_2)

# ----
# To do
# 
# visualize roller support points
# 
# Specified applied load values
# 
# movable points (optional: movable groundstructure)
# 
# color
# 
# Specify domain size
# and the nX,nY,nZ are divisions instead of keep adding
filter = StreamFilter(Gate=list)

interconnected_lines = Line(inter_2)
len = Length(Curve=interconnected_lines)
smaller = SmallerThan(FirstNumber=len, SecondNumber=max_members_length)  # -> SmallerThan, OrEqualTo
cull_2 = CullPattern(List=interconnected_lines, CullPattern=smaller.SmallerThan)
filter_2 = StreamFilter(Gate=apply_length_limit, Stream0=interconnected_lines, Stream1=cull_2)

# ---- group: Ground Structure
line = Line(filter_2)
pt_2 = Point(cull)

# ----
pipeline = GeometryPipeline(
    GroupByLayer=False,
    GroupByType=False,
    IncludeHidden=True,
    IncludeLocked=True,
    LayerFilter="Holes",
    NameFilter="*",
    SublayerFiltering=True,
    TypeFilter=4)
pipeline_2 = GeometryPipeline(
    GroupByLayer=False,
    GroupByType=False,
    IncludeHidden=True,
    IncludeLocked=True,
    LayerFilter="Restricted bars",
    NameFilter="*",
    SublayerFiltering=True,
    TypeFilter=4)

# ---- group: Preprocessing (Adam)
supoprt_points = ListItem(List=pt_2, Index=0, Wrap=True)  # -> Item, Item1, Item2
create = CreateNetwork(
    Edges=flatten(line),
    Anchors=[supoprt_points.Item, supoprt_points.Item1, supoprt_points.Item2],
    ForceDensities=1,
    IntersectionTolerance=Slider(0.02, range=0..0.1))
info = NetworkInformation(FDMNetwork=create)  # -> Nodes, Edges, EdgeLengths, StartIndex, EndIndex, Anchors, ForceDensities, NumberEdges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

# ----
fsim = FindSimilarMember(Data=line, Set=pipeline_2)  # -> Hit, Index
bcx = BrepCurve()  # -> Curves, Points
index = ItemIndex(List=line, Item=pipeline_2)
pipeline_3 = GeometryPipeline(
    GroupByLayer=False,
    GroupByType=False,
    IncludeHidden=True,
    IncludeLocked=True,
    LayerFilter="Supports (roller)",
    NameFilter="*",
    SublayerFiltering=True,
    TypeFilter=1)
pipeline_4 = GeometryPipeline(
    GroupByLayer=False,
    GroupByType=False,
    IncludeHidden=True,
    IncludeLocked=True,
    LayerFilter="Supports (pin)",
    NameFilter="*",
    SublayerFiltering=True,
    TypeFilter=1)
pipeline_5 = GeometryPipeline(
    GroupByLayer=False,
    GroupByType=False,
    IncludeHidden=True,
    IncludeLocked=True,
    LayerFilter="Load points",
    NameFilter="*",
    SublayerFiltering=True,
    TypeFilter=1)

crv = Curve(pipeline_2)  # disabled
curvepoint = PointOnCurve(crv, parameter=1)  # disabled
curvepoint_2 = PointOnCurve(crv, parameter=0)  # disabled
crv_2 = Curve(info.Edges)  # disabled
curvepoint_3 = PointOnCurve(crv_2, parameter=1)  # disabled
curvepoint_4 = PointOnCurve(crv_2, parameter=0)  # disabled
mindex = MemberIndex(Set=info.Nodes, Member=curvepoint)  # -> graft(Index), Count; disabled
mindex_2 = MemberIndex(Set=info.Nodes, Member=curvepoint_2)  # -> graft(Index), Count; disabled
merge = Merge(Data1=mindex_2.Index, Data2=mindex.Index)  # -> simplify(Result); disabled
mindex_3 = MemberIndex(Set=info.Nodes, Member=curvepoint_3)  # -> flatten(Index), Count; disabled
mindex_4 = MemberIndex(Set=info.Nodes, Member=curvepoint_4)  # -> flatten(Index), Count; disabled
equals = Equality(FirstNumber=mindex_2.Index, SecondNumber=mindex_4.Index)  # -> Equality, Inequality; disabled
equals_2 = Equality(FirstNumber=mindex.Index, SecondNumber=mindex_3.Index)  # -> Equality, Inequality; disabled
panel = Panel("1")  # disabled
panel_2 = Panel([mindex_2.Index, mindex.Index])  # disabled
panel_3 = Panel(merge)  # disabled
multiplication = Multiplication(A=equals.Equality, B=equals_2.Equality)  # -> simplify(Result); disabled
index_2 = ItemIndex(List=simplify(equals.Equality), Item=panel)  # disabled
fsim_2 = FindSimilarMember(Data=simplify(multiplication), Set=panel)  # -> Hit, Index; disabled
mindex_5 = MemberIndex(Set=multiplication, Member=panel)  # -> Index, Count; disabled
ma = MassAddition(Input=multiplication)  # -> Result, PartialResults; disabled
panel_4 = Panel(fsim_2.Hit)  # disabled

support_roller_inds = MemberIndex(Set=info.Nodes, Member=pipeline_3)  # -> simplify(flatten(Index)), Count
support_pin_inds = MemberIndex(Set=info.Nodes, Member=pipeline_4)  # -> simplify(flatten(Index)), Count
support_pin_inds_2 = MemberIndex(Set=info.Nodes, Member=pipeline_5)  # -> simplify(flatten(Index)), Count
number_slider = Slider(20, range=0..20)
panel_5 = Panel(support_roller_inds.Index)
y_kn = Panel("""0
0
0
0
0
0
0
0
0
0
0
0
0
0
0
0
0
0
0
0""")
x_kn = Panel("""0
0
0
0
0
0
0
0
0
0
0
0
0
0
0
0
0
0
0
0""")
z_kn = Panel("""-10
-10
-10
-10
-10
-10
-10
-10
-10
-10
-10
-10
-10
-10
-10
-10
-10
-10
-10
-10""")
crv_3 = Curve(info.Edges)
item = ListItem(List=info.StartIndex, Index=number_slider, Wrap=True)
item_2 = ListItem(List=info.EndIndex, Index=number_slider, Wrap=True)
lng = ListLength(List=support_pin_inds_2.Index)
item_3 = ListItem(List=info.Nodes, Index=info.EndIndex, Wrap=True)
item_4 = ListItem(List=crv_3, Index=number_slider, Wrap=True)
item_5 = ListItem(List=info.Nodes, Index=item, Wrap=True)
item_6 = ListItem(List=info.Nodes, Index=item_2, Wrap=True)
concat = Concatenate(FragmentA="Please input ", FragmentB=lng, FragmentC=" load values as [x, y, z] kN")
panel_6 = Panel(concat)
merge_2 = Merge(Data1=graft(y_kn), Data2=graft(y_kn), Data3=graft(z_kn))  # -> simplify(Result)
item_7 = ListItem(List=info.Nodes, Index=info.StartIndex, Wrap=True)
panel_7 = Panel(merge_2)
pt2num = PointsToNumbers(Points=graft(info.Nodes), Mask=4)  # -> simplify(Numbers)
time = Time()
Y = UnitY(Factor=Slider(6, range=0..20))
move = Move(Geometry=line, Motion=Y)  # -> Geometry, Transform
number_slider_2 = Slider(0.05, range=0..0.1)
supports_inds = Number(support_pin_inds.Index)
load_inds = Number(support_pin_inds_2.Index)

# ---- group: Loads Visualization
item_8 = ListItem(List=info.Nodes, Index=load_inds, Wrap=True)
cone = Cone(Base=item_8, Radius=0.1, Length=expr("x/100", z_kn))  # -> Cone, Tip
move_2 = Move(Geometry=cone.Cone, Motion=Vector(0, 0, 0.1))  # -> Geometry, Transform
preview = CustomPreview(Geometry=move_2.Geometry, Material=ColourSwatch(SwatchColor=RGB(255, 64, 64)))

# ---- group: Supports Visualization
item_9 = ListItem(List=info.Nodes, Index=supports_inds, Wrap=True)
cone_2 = Cone(Base=item_9, Radius=number_slider_2, Length=number_slider_2)  # -> Cone, Tip
preview_2 = CustomPreview(Geometry=cone_2.Cone, Material=ColourSwatch(SwatchColor=RGB(64, 255, 175)))

# ----
python_4 = GhPythonScript(
    elements_i=info.StartIndex,
    elements_j=info.EndIndex,
    points=pt2num,
    supports_pin=supports_inds,
    supports_rollery=support_roller_inds.Index,
    load_points=load_inds,
    load_values=merge_2,
    maxVf=max_volume_fraction,
    time=time,
    ndim=list)  # -> out; inputs elements_i: list, elements_j: list, points: tree, supports_pin: list, supports_rollery: list, load_points: list, load_values: tree
# ---------- python_4: Python ----------
__author__ = "pitipatw"
__version__ = "2023.03.10"

import rhinoscriptsyntax as rs
import ghpythonlib.treehelpers as th
import json

# assign static values
output = dict() 
output["model_name"] = "Example_1"
output["unit"] = "meter"
output["generate_time"] = "10PM"

output["model_type"] = "truss"

output["_info"] = "Example1"
output["TO_model_type"] = "ground_mesh"
# Processing Inputs
tree = th.tree_to_list(points, retrieve_base = None)

#input materials detail
materials = dict()
materials = [{"G12": 1.0,
            "E": 1.0,
            "name": "DummyMaterial",
            "family": "DummyMaterial",
            "density": 78.5,
            "elem_tags": [],
            "E_unit": "kN/m2",
            "type_name": "ISO",
            "fy": 235000.0,
            "mu": 0.3,
            "density_unit": "kN/m3",
            "fy_unit": "kN/m2",
            "G12_unit": "kN/m2"}]
output["materials"] = materials

#make a default of 2 but then able to put in 3
output["dimension"] = ndim


cross_secs = dict() 
cross_secs["A"] = 1 
cross_secs["name"] = ""
cross_secs["family"] = "DummyCroSecByPitipat"
cross_secs["elem_tags"] = []
cross_secs["A_unit"] = "m2" 
cross_secs["Iy"]= 2.1106547193827362e-06
cross_secs["Iz"]= 2.1106547193827362e-06
cross_secs["Jx"]= 4.2213094387654724e-06
cross_secs["name"]= "ex1"
output["cross_secs"] = [cross_secs]


nodes = dict()
nodes_list = list()
for i in range(len(tree)):
    dummy = dict()
    dummy["node_ind"] = i
    dummy["point"] = tree[i][0:3]
    dummy["is_grounded"] = False
    nodes_list.append(dummy)

output["nodes"] = nodes_list
elements_list = list() 
for i in range(len(elements_i)) : 
    dummy = dict() 
    dummy["elem_ind"] = i
    dummy["end_node_inds"] = [ elements_i[i], elements_j[i]]
    dummy["elem_tag"] = ""
    dummy["bending_stiff"] = False
    elements_list.append(dummy)

supports_list = list()

check = True
for i in supports_pin:
    dummy = dict()
    dummy["node_ind"] = int(i)
    dummy["condition"] = [1,1,1,0,0,0] # pin x y z
    supports_list.append(dummy)
        
for i in supports_rollery :
    dummy = dict()
    dummy["node_ind"] = int(i)
    dummy["condition"] = [0,0,1,0,0,0] #
    supports_list.append(dummy)

for i in range(len(tree)): 
    if i not in supports_rollery:
        if i not in supports_pin:
            dummy = dict()
            dummy["node_ind"] = int(i)
            dummy["condition"] = [0,0,0,0,0,0] # roller on y
            supports_list.append(dummy)

output["supports"] = supports_list


output["joints"] = []

load_value_list = th.tree_to_list(load_values, retrieve_base = None)

loadcases_dict = dict()
#this is load case "0"
loadcases_0 = dict()
loadcases_0["lc_ind"] = 0
ploads = dict()
load_list = list()
for i in range(len(load_points)) :
    dummy = dict()
    dummy["node_ind"] = load_points[i]
    if i > (len(load_value_list)-1) : 
        x = 0.0
        y = 0.0 
        z = 0.0
    else:
        [x,y,z] = load_value_list[i]
    dummy["force"]  = [int(x),int(y),int(z)]
    dummy["moment"] = [0.0, 0.0, 0.0] #No moment for now
    dummy["loadcase"] = str(i)
    dummy["force_unit"] = "kN"
    load_list.append(dummy)
loadcases_0["ploads"] = load_list
loadcases_0["eloads"] = []
loadcases_0["gravity"] = ""
loadcases_dict["0"] = loadcases_0

output["loadcases"] = loadcases_dict


output["elements"] = elements_list

#====Node and Element numbers are here!====
output["node_num"] = len(tree)
output["element_num"] = len(elements_list) 
#====

output["maxVf"] = maxVf
output["stage"] = "Opt"
print(json.dumps(output))
# ---------- end python_4 ----------
python_5 = GhPythonScript(points=pt2num)  # -> out; inputs points: tree
# ---------- python_5: Python ----------
__author__ = "pitipatw"
__version__ = "2023.03.10"

import rhinoscriptsyntax as rs
import ghpythonlib.treehelpers as th
import json

# assign static values
output = dict() 
output["model_name"] = "Example_1"
output["unit"] = "meter"
output["generate_time"] = "10PM"

output["model_type"] = "truss"

output["_info"] = "Example1"
output["TO_model_type"] = "ground_mesh"

# Processing Inputs
tree = th.tree_to_list(points, retrieve_base = None)


nodes = dict()
nodes_list = list()
for i in range(len(tree)):
    dummy = dict()
    dummy["node_ind"] = i
    dummy["point"] = tree[i][0:3]
    dummy["is_grounded"] = False
    nodes_list.append(dummy)

output["nodes"] = nodes_list

print(json.dumps(output))
# ---------- end python_5 ----------
roller_supports_inds = Number(support_roller_inds.Index)

# ---- group: WebSockets for Julia
server_port = Panel("ws://127.0.0.1:2000/")
websocket_client_start = WebsocketClientStart(Address=server_port, InitalMessage=python_4, Reset=optimization)
websocket_client_start_2 = WebsocketClientStart(Address=server_port, InitalMessage=python_5, Reset=groundstruct)
toggle = BooleanToggle(True)
websocket_client_receiver = WebsocketClientReceiver(WebsocketObjects=[websocket_client_start, websocket_client_start_2], AutoUpdate=toggle)  # -> Message, Status
panel_8 = Panel(websocket_client_receiver.Message)
panel_9 = Panel(websocket_client_receiver.Status)

# ---- group: Supports Visualization
item_10 = ListItem(List=info.Nodes, Index=roller_supports_inds, Wrap=True)
cone_3 = Cone(Base=item_10, Radius=number_slider_2, Length=number_slider_2)  # -> Cone, Tip
preview_3 = CustomPreview(Geometry=cone_3.Cone, Material=ColourSwatch(SwatchColor=RGB(64, 86, 255)))

# ----
panel_10 = Panel(python_5)
websocket_client_receiver_2 = WebsocketClientReceiver(WebsocketObjects=websocket_client_start_2, AutoUpdate=toggle)  # -> Message, Status
python_6 = GhPythonScript(input=websocket_client_receiver_2.Message, points=pt2num)  # -> out, output; inputs points: tree
# ---------- python_6: Python ----------
__author__ = "pitipatw"
__version__ = "2023.01.24"

import rhinoscriptsyntax as rs
import ghpythonlib.treehelpers as th
import json


output = []
list_points= th.tree_to_list(points, retrieve_base = None)
print(list_points)
dictofelements = json.loads(input)
for i in range(len(dictofelements)):
    temp = (dictofelements[str(i)])
    #, points[i])
    output.append(temp)
    
    
print(output[1])
print(output)
# ---------- end python_6 ----------
vec2pt = Vector2Pt(PointA=item_7, PointB=item_3, Unitize=False)  # -> Vector, Length
python_7 = GhPythonScript(input=websocket_client_receiver.Message, points=pt2num)  # -> out, output; inputs points: tree; same code as python_6
larger = LargerThan(FirstNumber=python_7.output, SecondNumber=0)  # -> LargerThan, OrEqualTo
cull_3 = CullPattern(List=item_7, CullPattern=larger.LargerThan)
cull_4 = CullPattern(List=vec2pt.Vector, CullPattern=larger.LargerThan)
cull_5 = CullPattern(List=vec2pt.Length, CullPattern=larger.LargerThan)
division_4 = Division(A=python_7.output, B=Slider(45, range=10..100))
cull_6 = CullPattern(List=division_4, CullPattern=larger.LargerThan)
multiplication_2 = Multiplication(A=cull_6, B=5)
circle = CircleCNR(Center=cull_3, Normal=cull_4, Radius=cull_6)
align = AlignPlanes()
rectangle = Rectangle(Plane=cull_3, XSize=multiplication_2, YSize=multiplication_2, Radius=0)  # -> Rectangle, Length
orient = Orient(Geometry=rectangle.Rectangle, Source=cull_4, Target=PlaneXY(0, 0, 0))  # -> Geometry, Transform
extr = Extrude(Base=circle, Direction=cull_4)
panel_11 = Panel(python_7.out)
extr_2 = Extrude(Base=rectangle.Rectangle, Direction=cull_4)
preview_4 = CustomPreview(Geometry=extr, Material=ColourSwatch(SwatchColor=RGB(0, 55, 255)))
cross_section = CrossSectionKaramba3D(FamilyNameOfCrossSection="DefaultCroSec", Diameter_cm=11.43, WallThickness_cm=0.4, mode="Circular Hollow")
item_11 = ListItem(List=info.Nodes, Index=support_pin_inds.Index, Wrap=True)
matprops = MaterialPropertiesKaramba3D(
    FamilyOfMaterial="Steel",
    Name="S235",
    YoungsModulus_kN_cm2=21000,
    InPlaneShearModulus_kN_cm2=8076,
    TransverseShearModulus_kN_cm2=8076,
    SpecificWeight_kN_m3=78.5,
    CoefficientOfThermalExpansion_1_C=1.2e-05,
    TensileStrength_kN_cm2=23.5,
    CompressiveStrength_kN_cm2=-23.5,
    StrengthHypothesis="MISES",
    mode="Isotrop")
line_2 = LineSDL(Start=cull_3, Direction=cull_4, Length=cull_5)
supp = SupportKaramba3D(PosInd=item_11, menu=[buttons(on, on, on, off, off, off)])
item_12 = ListItem(List=info.Nodes, Index=support_pin_inds_2.Index, Wrap=True)
Z = UnitZ(Factor="-10")
explode = Explode(Curve=line_2, Recursive=True)  # -> Segments, Vertices
loads = LoadsKaramba3D(ForceVector=Z, Local=False, PosInd=item_12, LCase="0", mode="Point")
duppt_2 = RemoveDuplicatePts(Points=flatten(explode.Vertices), Tolerance=0.01)
material = MaterialKaramba3D(matprops)
linetobeam = LineToBeamKaramba3D(
    Line=line_2,
    New=True,
    Remove=True,
    LimitDistance_m=0.005,
    Bending=True,
    SetBucklingLength=True,
    ToPolylineMaxAngle=0.03,
    ToPolylineTolerance=0.01,
    ToPolylineMaxEdgeLength=0.25)  # -> Element, Points, Info
support = SupportKaramba3D(supp)
load = LoadKaramba3D(loads)
assemble = AssembleModelKaramba3D(
    Point=duppt_2,
    Elem=linetobeam.Element,
    Support=support,
    Load=load,
    CrossSection=cross_section,
    Material=material,
    LimitDistance_m=0.005)  # -> Model, Info, Mass_kg, CenterOfGravity, LoadCaseNames
analyze = AnalyzeKaramba3D(Model=assemble.Model)  # -> CalculatedModel, MaximumDisplacement_cm, ResultingForceOfGravity_kN, ElasticEnergyChange_kNm
b_forces = BeamForcesKaramba3D(AnalyzedModel=analyze.CalculatedModel, Ts=[0, 1])  # -> AnalyzedModel, NormalForce_kN, ShearForceVz_kN, ShearForceVy_kN, TorsionalMomentMt_kNm, BendingMomentMy_kNm, BendingMomentMz_kNm

# ==== cluster Time
time = ConstructTime(Hour=20, Minute=48, Second=0)
date = ConstructDate(Year=2023, Month=2, Day=7, Hour=12, Minute=0, Second=0)
cdate = CombineDateTime(Date=date, Time=time)
panel = Panel(cdate)
panel_2 = ClusterOutput(panel)
